# Grasshopper definition gh-ai-script.gh (Grasshopper 1.0.7)
# plug-ins: ggRhinoIFC, FalseStartToggle, GH_CPython, ShapeDiverForGrasshopper

sddp = ShapeDiverDocumentPayload({AbsoluteTolerance=0, AngleTolerance=0, DistanceDisplayPrecision=0, GltfVersion="Gltf2", GrasshopperVersion="1.0.0007", InputGroups="{}", OutputGroups="{}", RelativeTolerance=0, RhinoVersion="7.36.23346.16351", UnitSystem=0, VersionCreated="1.17.0.0", VersionSaved="1.17.0.0"})
path = FilePath("IFC file path")

false_start_toggle = FalseStartToggle(False)
pick_n_choose = PickNChoose(Pattern=false_start_toggle, Stream1=path)
ggifc = GgIFCReadFile(FilePath=pick_n_choose, AppendData=True)  # -> IfcProject, IfcMaterials, IfcTypeObjects
pick_n_choose_2 = PickNChoose(Pattern=false_start_toggle, Stream1=ggifc.IfcProject)
ggifc_decompose_project = GgIFCDecomposeProject(IFCProject=pick_n_choose_2)  # -> GlobalID, Name, Description, IFCRootSiteOrBuilding, LongName, Phase, IFCTypeProducts, ModelTransform
ggifc_decompose_site = GgIFCDecomposeSite(IFCSite=ggifc_decompose_project.IFCRootSiteOrBuilding)  # -> Name, IFCBuildings, IFCSiteProducts, Description, GlobalId
ggifc_decompose_building = GgIFCDecomposeBuilding(IfcBuilding=ggifc_decompose_site.IFCBuildings)  # -> Name, IFCBuildingStories, IFCBuildingProducts, IFCDescription, IFCGlobalID

false_start_toggle_2 = FalseStartToggle(False)
pick_n_choose_3 = PickNChoose(Pattern=false_start_toggle_2, Stream1=graft(ggifc_decompose_building.IFCBuildingStories))  # -> flatten(Result)
ggifc_decompose_building_storey = GgIFCDecomposeBuildingStorey(IfcBuildingStorey=pick_n_choose_3)  # -> Name, Elevation, IFCSpaces, flatten(IFCBuildingStoreyProducts), IFCBuildingStoreyGrids, Description, GlobalId

false_start_toggle_3 = FalseStartToggle(False)
pick_n_choose_4 = PickNChoose(Pattern=false_start_toggle_3, Stream1=graft(ggifc_decompose_building_storey.IFCBuildingStoreyProducts))  # -> flatten(Result)
ggifc_productgetgeometry = GgIFCProductGetGeometry(
    IfcProduct=pick_n_choose_4,
    Deviation="1",
    Tolerance="0.00001",
    AngleTol=0.001745329252,
    ConnectedFaceSetsAsMesh=True,
    CSG=True,
    Unweld=0.3839724354)

data = Data(ggifc_decompose_building_storey.IFCBuildingStoreyProducts)
text_split = TextSplit(Text=graft(data), Separators="('")
list_item = ListItem(List=text_split, Index=Slider(2, range=0..10), Wrap=True)  # -> flatten(Item)

path_2 = FilePath(path)
false_start_toggle_4 = FalseStartToggle(False)
data_2 = Data(list_item)
replace_text = ReplaceText(Text=path_2, Find="\", Replace="/", RecursiveReplace=False)
circular_property_values = Panel("""CircularElementName
CircularElementDescription
CircularityNotes
InstallationYear
LastInspectionDate
ExpectedServiceLife
MaintenanceInterval""")
test_ifcopenshell = GH_CPython(start=false_start_toggle_4, ifc_file_path=replace_text, global_ids=data_2, prop_names=circular_property_values)  # -> debug_msgs, names_tree, values_tree, matched_properties_all; inputs start: list, ifc_file_path: list, global_ids: list, prop_names: list
#   port ifc_file_path: [required] - [type = int] - [default = None] Descripe your input here * bullet point. * bullet point
# ---------- test_ifcopenshell: Python ----------
import ifcopenshell

# Inputs:
# ifc_file_path: str
# global_ids: list of str
# start: bool
# prop_names: list of str

property_sets_all = {}
matched_properties_all = {}
names_tree = []
values_tree = []
debug_msgs = []  # Collect debug messages

if start:
    try:
        ifc_file_path = ifc_file_path.replace("\\", "/")
        debug_msgs.append(f"Opening IFC file: {ifc_file_path}")
        ifc = ifcopenshell.open(ifc_file_path)

        # Ensure global_ids is always a list
        if isinstance(global_ids, str):
            global_ids = [global_ids]

        for gid in global_ids:
            debug_msgs.append(f"Processing GlobalId: {gid}")
            element = ifc.by_guid(gid)
            matched_properties = {name: None for name in prop_names}

            if element:
                debug_msgs.append(f"Element found: {element}")
                for rel in element.IsDefinedBy:
                    if rel.is_a("IfcRelDefinesByProperties") and rel.RelatingPropertyDefinition.is_a("IfcPropertySet"):
                        pset = rel.RelatingPropertyDefinition
                        property_sets_all[gid] = property_sets_all.get(gid, {})
                        property_sets_all[gid][pset.Name] = {}

                        for prop in pset.HasProperties:
                            if prop.is_a("IfcPropertySingleValue"):
                                value = prop.NominalValue.wrappedValue
                                property_sets_all[gid][pset.Name][prop.Name] = value
                                if prop.Name in prop_names:
                                    matched_properties[prop.Name] = value
                                    debug_msgs.append(f"Found {prop.Name}: {value}")
                            else:
                                value = str(prop)
                                property_sets_all[gid][pset.Name][prop.Name] = value
                                if prop.Name in prop_names:
                                    matched_properties[prop.Name] = value
                                    debug_msgs.append(f"Found {prop.Name}: {value}")
            else:
                property_sets_all[gid] = {"Error": f"Element with GlobalId {gid} not found"}
                debug_msgs.append(f"Element with GlobalId {gid} not found")

            # Build grafted tree: wrap each element's list in another list
            names_tree.append([[k for k in matched_properties.keys() if k != "<empty>"]])
            values_tree.append([[v for k, v in matched_properties.items() if k != "<empty>"]])
            matched_properties_all[gid] = matched_properties

    except Exception as e:
        debug_msgs.append(f"Error: {str(e)}")

else:
    debug_msgs.append("Start toggle is off")
# ---------- end test_ifcopenshell ----------
panel = Panel(test_ifcopenshell.debug_msgs)
list_length = ListLength(List=circular_property_values)
partition_list = PartitionList(List=test_ifcopenshell.names_tree, Size=list_length)
partition_list_2 = PartitionList(List=test_ifcopenshell.values_tree, Size=list_length)

panel_2 = Panel(partition_list)
panel_3 = Panel(partition_list_2)

replace_text_2 = ReplaceText(Text=panel_3, Find="None", Replace="Missing", RecursiveReplace=False)
replace_text_3 = ReplaceText(Text=replace_text_2, Find="'", RecursiveReplace=False)
panel_4 = Panel("""Additional information
Balcony elements
Balcony elements show higher damage than other elements due to much higher exposure to the external factors
Facade panels
Facade panels show typical weather exposure damage
Bathroom panels
Bathroom elements show higher water damage, and often mold""")
panel_5 = Panel("""This is a list of circular parameters from an inventory of a fragment of a prefabricated reinforced concrete building in large panel system in Poland from the 1970s. The data is taken from an IFC file.

Assess the missing data and fill in the gaps. Please send back a prompt that consists only of the data.

The property list is separated by a '/' sign: """)
text_join = TextJoin(Text=circular_property_values, Join="/")
text_join_2 = TextJoin(Text=replace_text_3, Join="/")
panel_6 = Panel("""#

The data list is separated by a '#' for each element:""")
text_join_3 = TextJoin(Text=flatten(text_join_2), Join="#")
concatenate = Concatenate(C=panel_4, Fragment_A=panel_5, Fragment_B=text_join, A=panel_6, B=text_join_3)
panel_7 = Panel(text_join_3)
panel_8 = Panel(concatenate)

panel_9 = Panel("You are an assistant that helps complete missing IFC data for a circular reuse component assessment of a prefabricated building.")
api_key = Panel("replace-with-own-api-key")
false_start_toggle_5 = FalseStartToggle(False)
ghpython_script = GhPythonScript(run=false_start_toggle_5, role_system_content=panel_9, prompt=concatenate, api_key=api_key)  # -> out, answer
# ---------- ghpython_script: Python ----------
import json
import urllib2

# Set OpenAI endpoint and headers
endpoint = "https://api.openai.com/v1/chat/completions"
headers = {
    "Content-Type": "application/json",
    "Authorization": "Bearer {}".format(api_key)
}

def call_chatgpt(prompt):
    payload = {
        "model": "gpt-4o",
        "messages": [
            {"role": "system", "content": role_system_content},
            {"role": "user", "content": run_prompt}
        ],
        "temperature": 0.5
    }

    req = urllib2.Request(endpoint, json.dumps(payload), headers)

    try:
        response = urllib2.urlopen(req)
        result = json.loads(response.read())
        return result['choices'][0]['message']['content']
    except Exception as e:
        return "Error: {}".format(e)

# Only run API call if run is True
if run:
    run_prompt = prompt
    answer = call_chatgpt(run_prompt)
else:
    answer = "Toggle 'run' to True to query ChatGPT"
# ---------- end ghpython_script ----------
panel_10 = Panel(ghpython_script.out)

text_split_2 = TextSplit(Text=ghpython_script.answer, Separators="#")
text_split_3 = TextSplit(Text=ghpython_script.answer, Separators="#")
data_3 = Data(graft(text_split_2))
text_split_4 = TextSplit(Text=data_3, Separators="/")

panel_11 = Panel(ghpython_script.answer)
data_4 = Data(simplify(partition_list_2))
data_5 = Data(simplify(text_split_4))
panel_12 = Panel(data_4)
panel_13 = Panel(data_5)

match_text = MatchText(Text=panel_12, Pattern=" None", Case=True)
panel_14 = Panel(match_text)
mass_addition = MassAddition(Input=match_text)  # -> Result, PartialResults
data_6 = Data(flatten(mass_addition.Result))

false_start_toggle_6 = FalseStartToggle(False)
panel_15 = Panel("""Assess the circularity score reuse possibility of the elements of the building based on the data. Return nothing more, but a list of scores in scale 0 to 100 for each element. Example:
15/25/100/0

___________________________""")
panel_16 = Panel("You are an assistant that helps complete missing IFC data for a circular reuse component assessment of a prefabricated building.")
concatenate_2 = Concatenate(FragmentC=panel_15, FragmentA=panel_11)
panel_17 = Panel(concatenate_2)
ghpython_script_2 = GhPythonScript(run=false_start_toggle_6, role_system_content=panel_16, prompt=concatenate_2, api_key=api_key)  # -> out, answer; same code as ghpython_script
panel_18 = Panel(ghpython_script_2.answer)
text_split_5 = TextSplit(Text=ghpython_script_2.answer, Separators="/")
division = Division(A=text_split_5, B=100)
bounds = Bounds(Numbers=division)
deconstruct_domain = DeconstructDomain(Domain=bounds)  # -> Start, End
gradient = Gradient(
    LowerLimit=deconstruct_domain.Start,
    UpperLimit=deconstruct_domain.End,
    Parameter=division,
    stops=[0: RGB(255, 0, 0), 0.5: RGB(255, 255, 0), 1: RGB(0, 128, 0)])
geometry = Geometry(ggifc_productgetgeometry)
data_7 = Data(graft(gradient))
custom_preview = CustomPreview(Geometry=geometry, Material=data_7)

division_2 = Division(A=data_6, B=Slider(1, range=0..1))
bounds_2 = Bounds(Numbers=division_2)
deconstruct_domain_2 = DeconstructDomain(Domain=bounds_2)  # -> Start, End
gradient_2 = Gradient(
    LowerLimit=deconstruct_domain_2.Start,
    UpperLimit=deconstruct_domain_2.End,
    Parameter=division_2,
    stops=[0: RGB(0, 128, 0), 0.5: RGB(255, 255, 0), 1: RGB(255, 0, 0)])
geometry_2 = Geometry(ggifc_productgetgeometry)
data_8 = Data(graft(gradient_2))
custom_preview_2 = CustomPreview(Geometry=geometry_2, Material=data_8)
